# Dynamo graph DetailsToJson.dyn (Dynamo 2.10.1.3976)
# packages: JsonData 2.0.2

# group: Elements Selection
all_elements_in_active_view = ElementsInView()

# group: Data capture & structuration
code_block = CodeBlock(el=all_elements_in_active_view)
# ---------- code_block.designscript (4 lines) ----------
String.Replace(el.Id+" "+el.Name," ","_");
el.GetParameterValueByName("AnimationDescriptionFR");
el.GetParameterValueByName("AnimationDescriptionNL");
el.GetParameterValueByName("AnimationOrder");
# ----------------------------------------
code_block_2 = CodeBlock(id=code_block.out0, animationOrder=code_block.out3, fr=code_block.out1, nl=code_block.out2) { values=[id,animationOrder,fr,nl]; List.Transpose(values); }

# group: Json creation
code_block_3 = CodeBlock { ["id","AnimationOrder","LegendFR","LegendNL"]; }
byKeysAndValues = JsonObject.ByKeysAndValues(keys=code_block_3, values=code_block_2.out1@L2, Nesting=false, Option="None")
file_path = Filename(".\DetailsToJson.Json")  # graph input
toJsonFile = JsonData.Utilities.Write.ToJsonFile(jsonObjects=byKeysAndValues, filepath=file_path)
